# Grasshopper definition HandtoEyeCalibration.gh (Grasshopper 1.0.8)
# plug-ins: Heteroptera, PRC.GH, NGon_RH8, Flexibility

crv = Curve(<curve referenced from the Rhino model>)
disc = Discontinuity(Curve=crv, Level=1)  # -> Points, Parameters
shatter = Shatter(Curve=crv, Parameters=disc.Parameters)
number_slider = Slider(-389, range=-1000..0)
divide = DivideCurve(Curve=shatter, Count=Slider(4, range=0..10), Kinks=False)  # -> flatten(Points), Tangents, Parameters
remove_dup_points = RemoveDuplicatrPoints(Points=divide.Points)
center = Center(Geometry=crv)  # -> Center, Dimension
Z = UnitZ(Factor=number_slider)
points = PointList(Points=remove_dup_points, Size=Slider(43, range=0..100))
Y = UnitY(Factor=number_slider)
move = Move(Geometry=center.Center, Motion=Z)  # -> Geometry, Transform
vec2pt = Vector2Pt(PointA=remove_dup_points, PointB=move.Geometry, Unitize=False)  # -> Vector, Length
yz = YZPlane(Origin=remove_dup_points)
pl = PlaneNormal(Origin=remove_dup_points, ZAxis=vec2pt.Vector)
xz = XZPlane(Origin=remove_dup_points)
geo = Geometry([<brep referenced from the Rhino model> x5, <curve referenced from the Rhino model> x2, <extrusion referenced from the Rhino model> x3, <brep referenced from the Rhino model>, <extrusion referenced from the Rhino model> x7, <brep referenced from the Rhino model>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])
mesh = Mesh(geo)
axis_6dof = AXISMotion6DOF(
    A01=Slider(-90, range=-180..180),
    A02=Slider(0, range=0..180),
    A03=Slider(20, range=0..180),
    A04=Slider(0, range=0..180),
    A05=Slider(-20, range=-90..180),
    A06=Slider(0, range=0..180),
    Speed=0)
mesh_2 = Mesh(<mesh referenced from the Rhino model>)
ptp = PTPMotion(Plane=yz, Speed=nan, Posture="0")
pt = ConstructPoint(XCoordinate=0, YCoordinate="24.08", ZCoordinate="128.26")
lin = LINMotion(Plane=yz, Speed=nan)
weld = WeldMesh(Mesh=mesh, Radius=0.001, Align=False, Use_RTree=False)
xy = XYPlane(Origin=pt)
ptp_path = PTPPath(PTPMotions=axis_6dof, Interpolation="C_PTP")
ptp_path_2 = PTPPath(PTPMotions=ptp, Interpolation="C_PTP")
c_path = CartesianPath(CartesianMotions=lin, Interpolation="C_DIS")
abb_irb6700_150 = ABBIRB670015032()
frame = FrameViaPlane(Plane=xy, FrameID="6")
custom_tool = CustomTool(ToolFrame=frame, Mesh=weld)
entwine = Entwine(Branch00=ptp_path, Branch01=ptp_path_2, Branch02=ptp_path, FlattenInputs=True)  # -> flatten(Result)
core_abb_rapid = CoreABBRAPID(
    SimulationSlider=Slider(0, range=0..1),
    ServerIPPort="https://127.0.0.1:5001",
    PRCCommands=entwine,
    Robot=abb_irb6700_150,
    ToolLibrary=custom_tool,
    massCustomization=False,
    serializedSettings="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",
    settingsOverrideVisible=False)  # -> SimulationValidity, SimulationResult, VisualizationReference
analysis = SimulationAnalysis(SimulationResult=core_abb_rapid.SimulationResult)  # -> AxisValues, CartesianPosition, Time, Colliding, OutOfReach, Singularity, InterpolationFactor, ID, Code, PRCID
path = FilePath("F:\")
py3 = Python3Script(pc_ip="192.168.0.7", code=analysis.Code, folder=path, folder_name="test", write=Button())  # -> out, modified_code
# ---------- py3: Python ----------
import os
import re

# --- Configuration ---
# Takes the pc_ip input directly from the Grasshopper node
my_pc_ip = pc_ip
my_pc_port = 5000
# ---------------------

def transform_rapid_code(input_text, pc_ip, pc_port):
    """Injects TCP socket communication into standard RAPID code with Error Handling."""
    
    variables_to_inject = f"""
    VAR socketdev client_socket;
    VAR string pc_ip := "{pc_ip}"; 
    VAR num pc_port := {pc_port};
    VAR bool socket_connected := FALSE;
"""

    custom_procedure = """
    PROC SendPoseAndCapture(robtarget p, speeddata spd)
        VAR robtarget p_curr;
        VAR string msg;
        VAR string ack;
        
        ! Move to position (always fine for calibration)
        MoveJ p, spd, fine, tool_0\\WObj:=wobjBase;
        
        WaitRob \\InPos;
        WaitTime 0.5;
        
        IF socket_connected THEN
            p_curr := CRobT(\\Tool:=tool_0 \\WObj:=wobjBase);
            
            msg := NumToStr(p_curr.trans.x, 3) + "," +
                   NumToStr(p_curr.trans.y, 3) + "," +
                   NumToStr(p_curr.trans.z, 3) + "," +
                   NumToStr(p_curr.rot.q1, 5) + "," +
                   NumToStr(p_curr.rot.q2, 5) + "," +
                   NumToStr(p_curr.rot.q3, 5) + "," +
                   NumToStr(p_curr.rot.q4, 5);
                   
            SocketSend client_socket \\Str:=msg;
            ! Wait for PC to respond, timeout after 5 seconds
            SocketReceive client_socket \\Str:=ack \\Time:=5; 
        ENDIF
        
    ERROR
        IF ERRNO = ERR_SOCK_TIMEOUT OR ERRNO = ERR_SOCK_CLOSED THEN
            TPWrite "TCP disconnected during capture. Skipping data send.";
            socket_connected := FALSE;
            TRYNEXT;
        ELSE
            TPWrite "Unknown TCP error.";
            socket_connected := FALSE;
            TRYNEXT;
        ENDIF
    ENDPROC
"""

    connection_code = """
        SocketCreate client_socket;
        ! Attempt to connect with a 3-second timeout
        SocketConnect client_socket, pc_ip, pc_port \\Time:=3;
        socket_connected := TRUE;
        TPWrite "Successfully connected to PC.";
"""

    close_code = """
        IF socket_connected THEN
            SocketSend client_socket \\Str:="DONE";
            SocketClose client_socket;
        ENDIF
        
    ERROR
        IF ERRNO = ERR_SOCK_TIMEOUT OR ERRNO = ERR_SOCK_CLOSED THEN
            TPWrite "Could not connect to PC socket. Running offline.";
            socket_connected := FALSE;
            TRYNEXT;
        ELSE
            TPWrite "Unknown error on connection.";
            socket_connected := FALSE;
            TRYNEXT;
        ENDIF
    """

    output_text = input_text

    # 1. Inject Variables before PROC main() - using lambda prevents backslash errors
    output_text = re.sub(r'(\s*PROC main\(\))', lambda m: variables_to_inject + m.group(1), output_text)
    
    # 2. Inject SocketConnect at the start of PROC main()
    output_text = re.sub(r'(PROC main\(\)\s*(?:ConfL \\Off;\s*)?(?:ConfJ \\On;\s*)?)', lambda m: m.group(1) + connection_code, output_text)
    
    # 3. Inject SocketClose and ERROR handling at the end of PROC main()
    output_text = re.sub(r'(\s*ENDPROC\s*ENDMODULE)', lambda m: close_code + m.group(1), output_text)

    # 4. Transform MoveJ to SendPoseAndCapture
    movej_pattern = re.compile(r'MoveJ\s+(\[\[.*?\],\s*\[.*?\],\s*\[.*?\],\s*\[.*?\]\])\s*,\s*([a-zA-Z0-9_]+)\s*,.*?;')
    output_text = movej_pattern.sub(r'SendPoseAndCapture \1, \2;', output_text)
    
    # 5. Append the custom procedure before ENDMODULE
    output_text = re.sub(r'(\s*ENDMODULE)', lambda m: custom_procedure + m.group(1), output_text)
    
    return output_text

# Handle both single string and list
if isinstance(code, list):
    code_text = "\n".join(code)
else:
    code_text = code
        
# Apply our transformation to add TCP functionality
if code_text:
    code_text = transform_rapid_code(code_text, my_pc_ip, my_pc_port)

# --- Execution ---
if write:
    full_path = os.path.join(folder, folder_name)
    
    if not os.path.exists(full_path):
        os.makedirs(full_path)    
    
    mod_path = os.path.join(full_path, "HandtoEye.modx")
    with open(mod_path, "w") as f:
        f.write(code_text)
    
modified_code = code_text
# ---------- end py3 ----------
panel = Panel(py3.modified_code)
